# Grasshopper definition visualization.gh (Grasshopper 0.9.80)
# plug-ins: Python Interpreter

panel = Panel("/Users/ytakzk/Documents/Processing/reactive_diffusion_network/marhing_cubes_for_voxels/output/")
panel_2 = Panel("C:\Users\ytakzk\Desktop\")
python = GhPythonScript(dir=panel, n=Slider(9, range=0..100))  # -> out, names; inputs n: Int32
# ---------- python: Python ----------
__author__ = "ytakzk"
__version__ = "2018.10.26"

import rhinoscriptsyntax as rs

nums = [i for i in range(n)]

names = []

for (i, j) in zip([nums[-1]] + nums[:-1], nums):
    names.append('%s%d_%d.obj' % (dir, i, j))

#for i in nums:
#    names.append('%s%d_%d.obj' % (dir, i, i+1))
# ---------- end python ----------
python_script = PythonScript(path=python.names)  # -> out, a, b
# ---------- python_script: Python ----------
import Rhino.Geometry as rg
file = open(path)
lines = file.readlines()
pts=[]
faces=[]
for line in lines:
    if line.find("v")==0 and line.find("n")==-1 and line.find("t")==-1:
        print line.split(' ')
        pts.Add(rg.Point3d(float((line.split(' '))[1]),float((line.split(' '))[2]),float((line.split(' '))[3])))
    if line.find("f")==0:
        if line.split(' ').Count==4:
            faces.Add(rg.MeshFace(int(line.split(' ')[1].split('/')[0])-1,int(line.split(' ')[2].split('/')[0])-1,int(line.split(' ')[3].split('/')[0])-1))
        if line.split(' ').Count==5:
            faces.Add(rg.MeshFace(int(line.split(' ')[1].split('/')[0])-1,int(line.split(' ')[2].split('/')[0])-1,int(line.split(' ')[3].split('/')[0])-1,int(line.split(' ')[4].split('/')[0])-1))
a=pts
b=faces
# ---------- end python_script ----------
panel_3 = Panel(python.names)
conmesh = ConstructMesh(Vertices=python_script.a, Faces=python_script.b)  # -> flatten(Mesh)
lng = ListLength(List=conmesh)
series = Series(Start=0, Step=Slider(9, range=0..50), Count=lng)
Z = UnitZ(Factor=series)
neg = Negative(Value=Slider(100, range=0..100))
series_2 = Series(Start=0, Step=Slider(80, range=0..100), Count=Slider(3, range=0..10))
num = Number(graft(series_2))
pt = ConstructPoint(XCoordinate=neg, YCoordinate=neg, ZCoordinate=0)
pt_2 = ConstructPoint(XCoordinate=series_2, YCoordinate=num, ZCoordinate=0)  # -> flatten(Point)
move = Move(Geometry=Z, Motion=pt)  # -> Geometry, Transform
move_2 = Move(Geometry=conmesh, Motion=move.Geometry)  # -> Geometry, Transform
move_3 = Move(Geometry=conmesh, Motion=pt_2)  # -> Geometry, Transform
